# Dynamo graph Generic Foundation.dyn (Dynamo 0.9.0.3067)

# group: Rebar Type
rebar_bar_type = RebarBarType("8 220S")

# group: Stirrup Bar Settings
rebar_bar_type_2 = RebarBarType("14 220S")
rebar_hook_orientation = RebarHookOrientation("Left")
rebar_hook_type = RevitRebarHookType("None")

# group: Geometry Selection
select_face = DSFaceSelection()  # 1 picked in the model
select_face_2 = DSFaceSelection()  # 1 picked in the model
select_model_element = DSModelElementSelection()  # 1 picked in the model

# group: Veritcal Bar Settings
cover_parameter = DoubleInput(200)
division = DoubleInput(4)
hook_length = DoubleInput(500)
bending_radius = DoubleInput(200)

# group: Stirrup Settings
stirrup_radius = DoubleInput(200)
stirrup_distance = DoubleInput(500)

foundation_rebar = Custom[Foundation Rebar](VerticalBarsBarType=rebar_bar_type, StirrupBarType=rebar_bar_type_2, StirrupHookOrientation=rebar_hook_orientation, StirrupHookType=rebar_hook_type, SurfaceBottom=select_face, SurfaceTop=select_face_2, VericalBarsCover=cover_parameter, VerticalBarsAmount=division, HostElement=select_model_element, StirrupRadius=stirrup_radius, VerticalBarsHookLength=hook_length, VerticalBarsBendingRadius=bending_radius, StirrupDistance=stirrup_distance)  # Standard Rebar for Foundations
watch = Watch(foundation_rebar.Stirrups)
watch_2 = Watch(foundation_rebar.Bars)
