# Dynamo graph DynamoWorkspace.dyn (Dynamo 0.8.0.950)

revitRebarHookType = RevitRebarHookType.RevitRebarHookType()
select_face = DSFaceSelection()  # 1 picked in the model
select_model_element = DSModelElementSelection()  # 1 picked in the model
cutRebarByPlane = Rebar.CutRebarByPlane(select_face, select_model_element)
select_edge = DSEdgeSelection()  # 1 picked in the model
select_edge_2 = DSEdgeSelection()  # 1 picked in the model
number = DoubleInput(10)
morphedRebar = Rebar.MorphedRebar(select_edge, select_edge_2, number)
select_model_element_2 = DSModelElementSelection()  # 1 picked in the model
id = Element.Id(select_model_element_2)
byCurve = RebarContainer.ByCurve(morphedRebar, id)
select_face_2 = DSFaceSelection()  # 1 picked in the model
number_2 = DoubleInput(4)
boolean = BoolSelector(false)
followingSurface = Rebar.FollowingSurface(select_face_2, number_2, arg3=boolean)
byCurve_2 = RebarContainer.ByCurve(followingSurface, id)
select_face_3 = DSFaceSelection()  # 1 picked in the model
select_faces = SelectFaces()  # 3 picked in the model
flatten = Flatten(select_faces)
number_3 = DoubleInput(0.3)
number_4 = DoubleInput(10)
boolean_2 = BoolSelector(false)
perpendicularRebar = Rebar.PerpendicularRebar(select_face_3, flatten, number_3, number_4, boolean_2)
flatten_2 = Flatten(perpendicularRebar)
select_model_element_3 = DSModelElementSelection()  # 1 picked in the model
id_2 = Element.Id(select_model_element_3)
byCurve_3 = RebarContainer.ByCurve(flatten_2, id_2)
